vi "Generate Waveform (Multi-Array).gvi"   [LabVIEW NXG 4.0.0]
inputs:
  "tx config in": T2 = {"rf enable 0"=FALSE, "rf config 0"={"antenna"="TX1", "frequency"=2000000000, "lo frequency"=-1, "level"=0}, "rf enable 1"=FALSE, "rf config 1"={"antenna"="TX1", "frequency"=2000000000, "lo frequency"=-1, "level"=0}, "transfer mode"="Finite", "sample rate"=10000000, "number of samples"=8192, "start trigger"="Immediate", "tone frequency"=100000}
  "number of samples": u32 = 300000
  "sample rate": f64 = 10000000
  "tone frequency": f64 = 130000
  "amplitude": f64 = 1
outputs:
  "Sample Number": u32
  "i": i16[]
  "q": i16[]
  "waveform": waveform<f64>[]
  "error out": error
  "Fs": f64
  "tx config out": T2
types:
  T1 = cluster{"antenna": string, "frequency": f64, "lo frequency": f64, "level": f64}
  "Start Trigger.gtype" = enum{"Software", "Digital Edge", "Rx Start Trigger", "Tx Start Trigger", "Immediate", "Future Time Event"}
  T2 = cluster{"rf enable 0": bool, "rf config 0": T1, "rf enable 1": bool, "rf config 1": T1, "transfer mode": enum{"Finite", "Continuous"}, "sample rate": f64, "number of samples": u32, "start trigger": "Start Trigger.gtype", "tone frequency": f64}
uses:
  GenLTEFrame1TxAnt.mli::GetLTEFrame1TxAnt
  NI::G Core::File IO (General)::Write Delimited Spreadsheet (Waveform Array).gvi
  NI::Analysis::Generation::Sine Waveform.gvi
diagram:
  call "GetLTEFrame1TxAnt"() -> (ComplexSamples=w1, Fs=w2)
  Property Node(instance in=$"tx config in") -> (instance out=w3)
  Array Size(array=w1) -> (size(s)=w4)
  Array Index(array=w4) -> (out0[0]=w5)
  To Unsigned 32 Bit Integer(number=w5) -> w6
  Property Node(instance in=w3, "number of samples"=w6, "sample rate"=w2) -> (instance out=w7)
  $"tx config out" <- w7
  $"Sample Number" <- w6
  $Fs <- w2
  Complex To Real And Imaginary(x + iy=w1)
  Reciprocal(x=w2) -> w8
  Build Waveform Node(dt=w8) -> (output waveform=w9)
  Build Waveform Node(dt=w8) -> (output waveform=w10)
  Build Array(w9, w10) -> w11
  call "Write Delimited Spreadsheet (Waveform Array).gvi"(delimiter=";", file=path "C:\\Users\\ge69mog\\Documents\\WaveformLTEFrame.csv", waveforms=w11)
  $waveform <- w11
  Property Node(instance in=w9) -> ("Y"=w12)
  Multiply(w12, 32767) -> w13
  To Signed 16 Bit Integer(number=w13) -> w14
  $i <- w14
  Property Node(instance in=w10) -> ("Y"=w15)
  Multiply(w15, 32767) -> w16
  To Signed 16 Bit Integer(number=w16) -> w17
  $q <- w17
  call "Sine Waveform.gvi"(sample rate=$"sample rate", samples=$"number of samples", amplitude=$amplitude, frequency=$"tone frequency", phase in=90) -> (error out=w18)
  call "Sine Waveform.gvi"(sample rate=$"sample rate", samples=$"number of samples", amplitude=$amplitude, frequency=$"tone frequency", phase in=0) -> (error out=w19)
  Merge Errors(w18, w19) -> (error out=w20)
  $"error out" <- w20
